# Grasshopper definition Relative contrast model.gh (Grasshopper 0.9.76)
# plug-ins: Python Interpreter, Ironbug

# Assign window properties
panel = Panel("glass")
honeybee = Honeybee_Honeybee()  # -> Vviiiiiiiiiizzz; plug-in component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
ladybug = Ladybug_Ladybug()  # -> Vviiiiiiiiiizzz; plug-in component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
radglassmaterial = Honeybee_RadianceGlassMaterial(materialName=panel, RTransmittance="0.68", GTransmittance="0.68", BTransmittance="0.68", refractiveIndex=1.52)  # -> avrgTrans, RADMaterial; plug-in component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
define_wall = Brep([<brep referenced from the Rhino model> x4])
brep = Brep(<brep referenced from the Rhino model>)
brep_2 = Brep(<brep referenced from the Rhino model>)
brep_3 = Brep(<brep referenced from the Rhino model>)
createhbsrfs = Honeybee_createHBSrfs(geometry=brep, srfType="5", RADMaterial=radglassmaterial.RADMaterial)  # -> readMe, simplify(HBSurface); plug-in component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
createhbsrfs_2 = Honeybee_createHBSrfs(geometry=brep_2, srfType="3")  # -> readMe, simplify(HBSurface); plug-in component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
# Define geometry
createhbsrfs_3 = Honeybee_createHBSrfs(geometry=define_wall, srfType="0")  # -> readMe, simplify(HBSurface); plug-in component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
createhbsrfs_4 = Honeybee_createHBSrfs(geometry=brep_3, srfType="2")  # -> readMe, simplify(HBSurface); plug-in component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
# Orientation and location
northarrow = Ladybug_North(north=Slider(45, range=0..100), scale=".05")  # -> northSign; plug-in component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
open_weather_file = Ladybug_OpenEPWWeatherFile(open=Toggle(True))  # -> epwFile; plug-in component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
brep_4 = Brep(flatten([createhbsrfs_2.HBSurface, createhbsrfs_3.HBSurface, createhbsrfs_4.HBSurface, createhbsrfs.HBSurface]))
genstandardciesky = Honeybee_GenerateStandardCIESky(
    north=northarrow,
    weatherFile=open_weather_file,
    month=Slider(4, range=0..12),
    day=Slider(21, range=0..21),
    hour=Slider(10, range=0..10),
    skyType="0")  # -> skyFilePath; plug-in component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
set_camera_type_to_fisheye = Panel("1")
toggle = BooleanToggle(True)
imagebasedsimulation = Honeybee_ImageBasedSimulation(
    skyFile=genstandardciesky,
    cameraType=set_camera_type_to_fisheye,
    simulationType=2,
    imageWidth="600",
    imageHeight="600",
    backupImages=0)  # -> analysisRecipe; plug-in component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
rundaylightanalysis = Honeybee_RunDaylightSimulation(
    HBObjects=flatten(brep_4),
    analysisRecipe=imagebasedsimulation,
    writeRad=toggle,
    runRad=toggle,
    numOfCPUs="4",
    workingDir="C:\Cleo",
    radFileName="Test",
    overwriteResults=True)  # -> readMe, analysisType, resultsUnit, results, testPts, flatten(luminance_files), radGeoFile, studyFolder, done; plug-in component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
# set the view
number_slider = Slider(334, range=0..360)

# ----
# Relative Contrast component
item = ListItem(List=rundaylightanalysis.studyFolder, Index=0, Wrap=True)
panel_2 = Panel(item)
relative_contrast = PythonScript(runIt=Toggle(False), imageDir=panel_2)  # -> RCPI, HDR_image
# ---------- relative_contrast: Python ----------
# -*- coding: utf-8 -*-
"""
Created on Thu Oct 26 11:04:00 2017

@author: mkj

Visual discomfort in buildings are often based on Daylight Glare Probability (DGP) index. DGP is used to quantify the percentage probability of glare perception under daylight conditions. 
Due to the structure of the formula, the DGP index only consider the discomfort due to high contrast between the center of the field of view and the surroundings to a limited extend. The Relative Contrast model can be used to detect potential visual discomfort based on the relative contrast in the field of view.  

In this component HDR images with angular fisheye perspective rendered by Radiance in Honeybee for Grasshopper are used for the investigation. The average luminance in the scene is calculated by Evalglare for each rendered image.

To assess the contrast, the illuminance of each pixel is derived using their RGB values. The relative contrast between the illuminance of the pixels is based on the standard deviation and weighted by their position index.


"""

#Some constants
NUMBER_OF_IMAGES= 1
IMAGE_SIZE= 600

from subprocess import *
import math

#Subprocess processing cmd with arguments. Returns standard output and error 
def runCmd(args):
      process= Popen(['cmd']+list(args),stdout= PIPE,stderr= PIPE)
      out= []
      while process.poll() is None:
        line= process.stdout.readline()
        if line!= '' and line.endswith('\n'):
          out.append(line[:-1])
      stdout,stderr= process.communicate()
      out+= stdout.split('\n')  
      return out

if runIt:
  
    #Directions to folders
    rootDir= "C:\\Radiance\\bin\\"
    #rootDir contains evalglare.exe, solid_angles_with_posx2.txt, LumFromHdr.jar

    args= ['/k','dir','/b',imageDir+'*.hdr']
    imageFiles= runCmd(args)
    #avgdata= array with average luminance values from evalglare.exe 
    avgdata= []
    for index in range(0,NUMBER_OF_IMAGES):
      args= ['/k',rootDir+'evalglare.exe','-d','-vth','-vv','180','-vh','180',imageDir+imageFiles[index]]
      data= runCmd(args)
      for index2 in range(len(data)):
          if data[index2].find(': ')!=-1:
              line=data[index2].split(": ")
              values= line[1].split(" ")
              avgdata.append(values[1])

    big= open(rootDir +"solid_angles_with_posx2.txt","r")
    lines= big.read().splitlines()
    big.close
    
    #Making matrix with values from solid_angles_with_posx2.txt
    w= len(lines[0].split(" "))
    h= len(lines)
    
    solidanglewposition= [[0 for y in range(h)] for x in range(w)]
    
    for y in range(h):
      items= lines[y].split(" ")
      for x in range(w):
        solidanglewposition[x][y]= float(items[x])
    
    #Creating a matrix with NaN's
    omegaIndex=[[0 for y in range(IMAGE_SIZE)] for x in range(IMAGE_SIZE)]
    for y in range(IMAGE_SIZE):
      for x in range(IMAGE_SIZE):
        omegaIndex[x][y]= float("NaN")
    
    #Building matrix omegaIndex with solid angle data 
    for y in range(h):
      omegaIndex[int(solidanglewposition[0][y])][int(solidanglewposition[1][y])-1]= solidanglewposition[2][y]*solidanglewposition[3][y] 
    
    lumFloatData= []
    for index in range(NUMBER_OF_IMAGES):
      #Use LumFromPic.jar to make luminance values for each pixels in the actual hdr-file 
      args= ['/k','java','-jar',rootDir+'LumFromHdr.jar',imageDir+imageFiles[index],rootDir+'lumValues.csv']
      notUsed= runCmd(args)
      
      #Read the luminance values into the luminance matrix
      lumFile= open(rootDir+"lumValues.csv",'r')
      lines= lumFile.read().splitlines()
      lumFile.close()
      luminance= [[0 for x in range(IMAGE_SIZE)] for y in range(IMAGE_SIZE)]
      for y in range(IMAGE_SIZE):
        items= lines[y].split(";")
        for x in range(IMAGE_SIZE):
          luminance[x][y]= float(items[x])
    
      #Building matrix lumMulOmega by element-wise multiplication from omegaIndex and luminance 
      lumMulOmega= [[0 for y in range(IMAGE_SIZE)] for x in range(IMAGE_SIZE)] 
      for y in range(IMAGE_SIZE):
       for x in range(IMAGE_SIZE):
        lumMulOmega[x][y]= omegaIndex[x][y]*luminance[x][y]
    
      #Calculating meanvalue
      antal= 0.0; sum= 0.0
      for y in range(IMAGE_SIZE):
        for x in range(IMAGE_SIZE):
          if not math.isnan(lumMulOmega[x][y]):
            antal+= 1.0
            sum+= lumMulOmega[x][y]
      
      #Calculating standard deviation
      mean= sum/antal
      sum= 0.0
      for y in range(IMAGE_SIZE):
        for x in range(IMAGE_SIZE):
          if not math.isnan(lumMulOmega[x][y]):
            sum+= (lumMulOmega[x][y]-mean)**2
      std= math.sqrt(sum/antal)
      
      #Formala equals standard deviation / average luminance from Evalglare
      lumFloatData.append(std/float(avgdata[index]))
    
    #results as string with 8 decimals
    lumdata= []
    for index in range(NUMBER_OF_IMAGES):
      lumdata.append('%.8f'%lumFloatData[index])
    
    print(lumdata)
# ---------- end relative_contrast ----------
# TO DO:
# - Figure out how to render nine images at the same time
# - Visualize data
# - Incorporate some sort of user-friendly error messages in case of wrong inputs
panel_3 = Panel(relative_contrast.RCPI)

# ----
# Honeybee glare analysis
glareanalysis = Honeybee_GlareAnalysis(HDRImagePath=rundaylightanalysis.luminance_files, runIt=Toggle(True))  # -> readMe, glareCheckImage, DGP, DGI, glareComfortRange, imageWithTaskArea; plug-in component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
hdr_gif = Honeybee_ConvertHDRToGIF(HDRFilePath=glareanalysis.glareCheckImage, adjustExposure=Toggle(False))  # -> GIFFilePath; plug-in component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
md_slider = MDSlider(
    slider_value=Point(0.5429780541, 0.4954536252, 0.5),
    SliderMode=0,
    x_domain=Domain(-1, 1),
    y_domain=Domain(-1, 1),
    z_domain=Domain(0, 1))
viewer = Ladybug_ImageViewer(ImagePath_=hdr_gif, _scale_=1, DisableClickable=False, SaveImgWithCoords=False, scale=1)  # -> ImagePath, Colors, GIF

pt = Point(Point(1.263298648, 0.9234887403, 0))
comfortmannequin = Ladybug_ComfortMannequin(rotationAngle=number_slider, bodyLocation=pt)  # -> mannequinMesh, legend, legendBasePt; plug-in component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

# ---- group: Person's face!
item_2 = ListItem(List=comfortmannequin.mannequinMesh, Index=121, Wrap=True)

# ----
preview = CustomPreview(Geometry=item_2, Shader=ColourSwatch(SwatchColor=RGB(255, 0, 0)))

facen = FaceNormals(Mesh=item_2)  # -> Centers, Normals
settheview = Ladybug_SetTheView(cameraLocation=facen.Centers, cameraDirection=facen.Normals, uvLookAround=md_slider)  # plug-in component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
